# Grasshopper definition dataGeneration.gh (Grasshopper 1.0.7)

n = Panel("2000")
run = BooleanToggle(False)
simple_random_samples = GhPythonScript(n=n, run=run)  # inputs n: Int32
# ---------- simple_random_samples: Python ----------
"""
Generates step^7 number of samples covering the entirety of the parametric design space
    Inputs:
        n: Number of data points to export
        run: Toggle "True" to export .ply files
    Remarks:
        Author: Ozguc Bertug Capunaman
        Project: Latent Heuristics
        Version: 2021.04.20
"""

import rhinoscriptsyntax as rs
import ghpythonlib.components as gh
import random, os, math

def writePC(fn, pc, dir):

    f = open(dir+fn+".ply", "w")
    f.write('ply\n')
    f.write('format ascii 1.0\n')
    f.write('element vertex {}\n'.format(len(pc)))
    f.write('property float x\n')
    f.write('property float y\n')
    f.write('property float z\n')
    f.write('end_header\n')
    
    for p in pc:
        f.write("{} {} {}\n".format(p[0],p[1],p[2]))
    f.close()
    print("Finished exporting {}.ply".format(fn))

def createFN(vars):
    fn = ""
    for i in range(len(vars)):
        if i != 0:
            fn+= "_"
        fn += str(vars[i])
    return fn



def randomSpline(s):
    
    h = random.uniform(.5, 1)
    bR = random.uniform(h*.2, h*.5)
    tR = random.uniform(bR*.25, bR)
    
    bZ = random.uniform(h*.1,h*.9)
    tZ = random.uniform(h*.1,h*.9)
    
    bX = random.uniform(bR, bR*2)
    tX = random.uniform(tR*.5, tR*2)
    
    pts = []
    pts.append(gh.ConstructPoint(bR, 0, 0))
    pts.append(gh.ConstructPoint(bX, 0, bZ))
    pts.append(gh.ConstructPoint(tX, 0, tZ))
    pts.append(gh.ConstructPoint(tR, 0, h))
    
    crv = gh.NurbsCurve(pts, 3, False)
    return crv

def main(n, dir):
    if not os.path.exists(dir):
            os.mkdir(dir)
    
    start = gh.ConstructPoint(0, 0, 0)
    end = gh.ConstructPoint(0, 0, 1)
    axis = gh.Line(start,end)
    
    for s in range(n):
        random.seed(s)
        crv = randomSpline(s).curve
        srf = gh.Revolution(crv, axis, "0 To 2*Pi")
        pc = gh.PopulateGeometry(srf, 2048, 1)
        
        fn = createFN(["simple", s])
        writePC(fn, pc, dir)

    return crv, srf

if run:
    crv, srf = main(n, dir="C:\\Users\\Ozguc\\Documents\\GitHub\\latentHeuristics\\ghData\\data\\00000001\\")
# ---------- end simple_random_samples ----------
spiral_random_samples = GhPythonScript(n=n, run=run)  # inputs n: Int32
# ---------- spiral_random_samples: Python ----------
"""
Generates step^7 number of samples covering the entirety of the parametric design space
    Inputs:
        n: Number of data points to export
        run: Toggle "True" to export .ply files
    Remarks:
        Author: Ozguc Bertug Capunaman
        Project: Latent Heuristics
        Version: 2021.04.20
"""

import rhinoscriptsyntax as rs
import ghpythonlib.components as gh
import random, os, math

def writePC(fn, pc, dir):

    f = open(dir+fn+".ply", "w")
    f.write('ply\n')
    f.write('format ascii 1.0\n')
    f.write('element vertex {}\n'.format(len(pc)))
    f.write('property float x\n')
    f.write('property float y\n')
    f.write('property float z\n')
    f.write('end_header\n')
    
    for p in pc:
        f.write("{} {} {}\n".format(p[0],p[1],p[2]))
    f.close()
    print("Finished exporting {}.ply".format(fn))

def createFN(vars):
    fn = ""
    for i in range(len(vars)):
        if i != 0:
            fn+= "_"
        fn += str(vars[i])
    return fn



def randomSpline(s):
    
    h = random.uniform(.5, 1)
    bR = random.uniform(h*.2, h*.5)
    tR = random.uniform(bR*.25, bR)
    
    bZ = random.uniform(h*.1,h*.9)
    tZ = random.uniform(h*.1,h*.9)
    
    bX = random.uniform(bR, bR*2)
    tX = random.uniform(tR*.5, tR*2)
    
    pts = []
    pts.append(gh.ConstructPoint(bR, 0, 0))
    pts.append(gh.ConstructPoint(bX, 0, bZ))
    pts.append(gh.ConstructPoint(tX, 0, tZ))
    pts.append(gh.ConstructPoint(tR, 0, h))
    
    crv = gh.NurbsCurve(pts, 3, False)
    return crv

def main(n, dir):
    if not os.path.exists(dir):
            os.mkdir(dir)
    
    start = gh.ConstructPoint(0, 0, 0)
    end = gh.ConstructPoint(0, 0, 1)
    axis = gh.Line(start,end)
    
    for s in range(n):
        random.seed(s)
        
        crv = randomSpline(s).curve
        
        div = 20
        pts = gh.DivideCurve(crv, div, False)[0]
        
        tA = random.uniform(-math.pi/2, math.pi/2) 
        bA = random.uniform(-math.pi/2, math.pi/2)
        peak = random.randint(0+1, len(pts)-1)
        bStep = bA/(peak+1)
        tStep = tA/(len(pts)-peak)
        
        for i in range(len(pts)):
            if i < peak:
                pts[i] = gh.Rotate(pts[i], bStep*(peak-i), gh.XYPlane("0,0,0"))[0]
            if i > peak:
                pts[i] = gh.Rotate(pts[i], tStep*(i-peak), gh.XYPlane("0,0,0"))[0]
        crv0 = gh.NurbsCurve(pts, 3, False).curve
       
        mult=random.uniform(.1,.25)
        
        for i in range(len(pts)):
           dist = gh.Distance(pts[i], "0,0,{}".format(pts[i][2]))
           
           vec = gh.Vector2Pt("{},{},{}".format(pts[i][0]*mult, pts[i][1]*mult,0), "0,0,0", False)[0]
           pts[i] = gh.Move(pts[i], vec)[0]
        crv1 = gh.NurbsCurve(pts, 3, False).curve
        
        crv = []
        nSpiral = random.randint(3, 20)
        for i in range(nSpiral):
            crv.append(gh.Rotate(crv0, (i*2*math.pi)/nSpiral, gh.XYPlane("0,0,0"))[0])
            crv.append(gh.Rotate(crv1, ((i*2*math.pi)/nSpiral)+(math.pi)/nSpiral, gh.XYPlane("0,0,0"))[0])
        
        srf = rs.AddLoftSrf(crv, closed=True)
        srf = rs.coercebrep(srf)
        pc = gh.PopulateGeometry(srf, 2048, 1)
        
        fn = createFN(["spiral", s])
        writePC(fn, pc, dir)
    return crv, srf

if run:
    crv, srf = main(n, dir="C:\\Users\\Ozguc\\Documents\\GitHub\\latentHeuristics\\ghData\\data\\00000001\\")
# ---------- end spiral_random_samples ----------
lowpoly_random_samples = GhPythonScript(n=n, run=run)  # inputs n: Int32
# ---------- lowpoly_random_samples: Python ----------
"""
Generates step^7 number of samples covering the entirety of the parametric design space
    Inputs:
        n: Number of data points to export
        run: Toggle "True" to export .ply files
    Remarks:
        Author: Ozguc Bertug Capunaman
        Project: Latent Heuristics
        Version: 2021.04.20
"""

import rhinoscriptsyntax as rs
import ghpythonlib.components as gh
import random, os, math
from itertools import permutations

def writePC(fn, pc, dir):

    f = open(dir+fn+".ply", "w")
    f.write('ply\n')
    f.write('format ascii 1.0\n')
    f.write('element vertex {}\n'.format(len(pc)))
    f.write('property float x\n')
    f.write('property float y\n')
    f.write('property float z\n')
    f.write('end_header\n')
    
    for p in pc:
        f.write("{} {} {}\n".format(p[0],p[1],p[2]))
    f.close()
    print("Finished exporting {}.ply".format(fn))

def createFN(vars):
    fn = ""
    for i in range(len(vars)):
        if i != 0:
            fn+= "_"
        fn += str(vars[i])
    return fn

def randomSpline(s):
    
    h = random.uniform(.5, 1)
    bR = random.uniform(h*.2, h*.5)
    tR = random.uniform(bR*.25, bR)
    
    bZ = random.uniform(h*.1,h*.9)
    tZ = random.uniform(h*.1,h*.9)
    
    bX = random.uniform(bR, bR*2)
    tX = random.uniform(tR*.5, tR*2)
    
    pts = []
    pts.append(gh.ConstructPoint(bR, 0, 0))
    pts.append(gh.ConstructPoint(bX, 0, bZ))
    pts.append(gh.ConstructPoint(tX, 0, tZ))
    pts.append(gh.ConstructPoint(tR, 0, h))
    
    crv = gh.NurbsCurve(pts, 3, False)
    return crv

def lowPoly(srf):
    mesh = gh.DeconstructMesh(srf)
    
    nSample = random.randint(15, 60)
    print(nSample)
    pc = gh.PopulateGeometry(srf, nSample, 1)
    edges = gh.BrepEdges(srf).naked
    for e in edges:
        nDiv = gh.Length(e)//.1
        if nDiv < 5:
            nDiv = 5
        pc.extend(gh.DivideCurve(e, nDiv, False).points)
    
    meshPts = []
    vertDict = {}
    for i in range(len(mesh.vertices)):
        cpi = gh.ClosestPoint(mesh.vertices[i], pc).cp_index
        meshPts.append(pc[cpi])
        vertDict[i] = cpi
    srf0 = gh.ConstructMesh(meshPts, mesh.faces)
    mesh = gh.DeconstructMesh(srf0)
    faceSet = []
    for f in mesh.faces:
        face = []
        verts = gh.DeconstructFace(f)
        face.append([vertDict[verts.corner_a],\
                vertDict[verts.corner_b],\
                vertDict[verts.corner_c]])
        if verts.corner_c != verts.corner_d:
            face.append([vertDict[verts.corner_a],\
                   vertDict[verts.corner_c],\
                   vertDict[verts.corner_d]])
        isIn = False
        for f in face:
            if f[0]!=f[1] and f[1]!=f[2] and f[0]!=f[2]:
                for p in permutations(f):
                    if tuple(p) in faceSet:
                        isIn = True
                        break
                if not isIn:
                    faceSet.append(tuple(f))
    faces=[]
    for f in faceSet:
        faces.append(gh.MeshTriangle(f[0], f[1], f[2]))
    srf = gh.ConstructMesh(pc, faces)
    return srf

def main(n, dir):
    if not os.path.exists(dir):
            os.mkdir(dir)
    
    start = gh.ConstructPoint(0, 0, 0)
    end = gh.ConstructPoint(0, 0, 1)
    axis = gh.Line(start,end)
    
    for s in range(n):
        random.seed(s)
        crv = randomSpline(s).curve
        srf = gh.Revolution(crv, axis, "0 To 2*Pi")
        srf = lowPoly(srf)
        
        pc = gh.PopulateGeometry(srf, 2048, 1)
        fn = createFN(["lowPoly", s])
        writePC(fn, pc, dir)

    return crv, srf

if run:
    crv, srf = main(n, dir="C:\\Users\\Ozguc\\Documents\\GitHub\\latentHeuristics\\ghData\\data\\00000001\\")
# ---------- end lowpoly_random_samples ----------
asymmetric_random_samples = GhPythonScript(n=n, run=run)  # inputs n: Int32
# ---------- asymmetric_random_samples: Python ----------
"""
Generates step^7 number of samples covering the entirety of the parametric design space
    Inputs:
        n: Number of data points to export
        run: Toggle "True" to export .ply files
    Remarks:
        Author: Ozguc Bertug Capunaman
        Project: Latent Heuristics
        Version: 2021.04.20
"""

import rhinoscriptsyntax as rs
import ghpythonlib.components as gh
import random, os, math

def writePC(fn, pc, dir):

    f = open(dir+fn+".ply", "w")
    f.write('ply\n')
    f.write('format ascii 1.0\n')
    f.write('element vertex {}\n'.format(len(pc)))
    f.write('property float x\n')
    f.write('property float y\n')
    f.write('property float z\n')
    f.write('end_header\n')
    
    for p in pc:
        f.write("{} {} {}\n".format(p[0],p[1],p[2]))
    f.close()
    print("Finished exporting {}.ply".format(fn))

def createFN(vars):
    fn = ""
    for i in range(len(vars)):
        if i != 0:
            fn+= "_"
        fn += str(vars[i])
    return fn



def randomSpline(s):
    
    h = random.uniform(.5, 1)
    bR = random.uniform(h*.2, h*.5)
    tR = random.uniform(bR*.25, bR)
    
    bZ = random.uniform(h*.1,h*.9)
    tZ = random.uniform(h*.1,h*.9)
    
    bX = random.uniform(bR, bR*2)
    tX = random.uniform(tR*.5, tR*2)
    
    pts = []
    pts.append(gh.ConstructPoint(bR, 0, 0))
    pts.append(gh.ConstructPoint(bX, 0, bZ))
    pts.append(gh.ConstructPoint(tX, 0, tZ))
    pts.append(gh.ConstructPoint(tR, 0, h))
    
    crv = gh.NurbsCurve(pts, 3, False)
    return crv

def crvFromCir(pt, r, reverse, deform):
    div = random.randint(3, 10)
    crv = rs.AddCircle(pt, r)
    
    cirPts = rs.DivideCurve(crv, div)
    
    if deform:
        ptR = random.uniform(r*.4, r*.8)
        ptA = random.uniform(0, 360)
        
        attr = rs.AddPoint(pt)
        rs.MoveObject(attr, (ptR,0,0))
        rs.RotateObject(attr, pt, ptA)
        
        for cirPt in cirPts:
            dist = rs.Distance(attr, cirPt)
            if dist < r and random.getrandbits(1):
                vec = rs.VectorCreate(cirPt, attr)
                vec = rs.VectorScale(vec, (r-dist)/(dist))
                
                if random.getrandbits(1) and reverse:
                    vec = rs.VectorReverse(vec)
                rs.MoveObject(cirPt, vec)
                
    cirPts.append(cirPts[0])
    crv = rs.AddInterpCurve(cirPts, knotstyle=4)
        
#    vec = rs.VectorCreate(pt, rs.CurveAreaCentroid(crv)[0])
#    crv = rs.MoveObject(crv, vec)
        
    return crv

def main(n, dir):
    if not os.path.exists(dir):
            os.mkdir(dir)
    
    start = gh.ConstructPoint(0, 0, 0)
    end = gh.ConstructPoint(0, 0, 1)
    axis = gh.Line(start,end)
    
    for s in range(n):
        random.seed(s)
        crv = randomSpline(s).curve
        pts = gh.ControlPoints(crv).points
#        pts = sorted(pts,key=lambda x:x[2])
        
        crv = []
        for i in range(len(pts)):
            reverse = True
            deform = True
            if i == 0:
                deform = False
            elif i == len(pts)-1:
                reverse = False
        
            c = crvFromCir("0,0,{}".format(pts[i][2]), pts[i][0], reverse, deform)
            crv.append(c)
        
        srf = rs.AddLoftSrf(crv, loft_type=1)
        srf = rs.coercebrep(srf)
        pc = gh.PopulateGeometry(srf, 2048, 1)
        
        fn = createFN(["asymmetric", s])
        writePC(fn, pc, dir)

    return crv, srf

if run:
    crv, srf = main(n, dir="C:\\Users\\Ozguc\\Documents\\GitHub\\latentHeuristics\\ghData\\data\\00000001\\")
# ---------- end asymmetric_random_samples ----------

# ---- group: Generate "simple" Design Space
simple_design_space = GhPythonScript(step="3", run=Toggle(False))  # inputs step: Int32
# ---------- simple_design_space: Python ----------
"""
Generates step^7 number of samples covering the entirety of the parametric design space
    Inputs:
        step: Number of samples to take from each domain
        run: Toggle "True" to export .ply files
    Remarks:
        Author: Ozguc Bertug Capunaman
        Project: Latent Heuristics
        Version: 2021.04.20
"""

__author__ = "Ozguc Bertug Capunaman"
__version__ = "2021.04.14"

import rhinoscriptsyntax as rs
import ghpythonlib.components as gh
import os

def writePC(fn, pc, dir):

    f = open(dir+fn+".ply", "w")
    f.write('ply\n')
    f.write('format ascii 1.0\n')
    f.write('element vertex {}\n'.format(len(pc)))
    f.write('property float x\n')
    f.write('property float y\n')
    f.write('property float z\n')
    f.write('end_header\n')
    
    for p in pc:
        f.write("{} {} {}\n".format(p[0],p[1],p[2]))
    f.close()
    print("Finished exporting {}.ply".format(fn))

def createFN(vars):
    fn = ""
    for i in range(len(vars)):
        if i != 0:
            fn+= "_"
        fn += str(int((vars[i]*100)))
    return fn

def main(dir):
    if not os.path.exists(dir):
            os.mkdir(dir)
    
    n = step
    
    start = gh.ConstructPoint(0, 0, 0)
    end = gh.ConstructPoint(0, 0, 1)
    axis = gh.Line(start,end)
    
    range_h = gh.Range("{} To {}".format(.5, 1), n-1)
    for h in range_h:
        range_z = gh.Range("{} To {}".format(h*.1, h*.9), n-1)
        
        range_bR = gh.Range("{} To {}".format(h*.2, h*.5), n-1)
        for bR in range_bR:
            range_bX = gh.Range("{} To {}".format(bR, bR*2), n-1)
            
            range_tR = gh.Range("{} To {}".format(bR*.25, bR), n-1)
            for tR in range_tR:
                range_tX = gh.Range("{} To {}".format(tR*.5, tR*2), n-1)
                for bX in range_bX:
                    for tX in range_tX:
                        for bZ in range_z:
                            for tZ in range_z:
                                pts = []
                                pts.append(gh.ConstructPoint(bR, 0, 0))
                                pts.append(gh.ConstructPoint(bX, 0, bZ))
                                pts.append(gh.ConstructPoint(tX, 0, tZ))
                                pts.append(gh.ConstructPoint(tR, 0, h))
    
                                crv = gh.NurbsCurve(pts, 3, False)[0]
                                srf = gh.Revolution(crv, axis, "0 To 2*Pi")
                                pc = gh.PopulateGeometry(srf, 2048, 1)
                                
                                fn = createFN([h, bR, bX, bZ, tX, tZ, tR])
                                writePC(fn, pc, dir)

if run:
    main(dir="C:\\Users\\Ozguc\\Documents\\GitHub\\latentHeuristics\\ghData\\data\\00000000\\")
# ---------- end simple_design_space ----------
