# Grasshopper definition dataVisualization.gh (Grasshopper 1.0.7)

number_slider = Slider(3, range=0..3)  # disabled
number_slider_2 = Slider(0, range=0..21)  # disabled
panel = Panel("spiral")  # disabled
path = FilePath("C:\Users\Ozguc\Documents\GitHub\latentHeuristics\out\ply\interpolate\custom_single\")
path_2 = FilePath("C:\Users\Ozguc\Documents\GitHub\latentHeuristics\out\ply\interpolate\custom_multi\")  # disabled
ln = Line(StartPoint="0,0,0", EndPoint="1,0,0")
interpolate_custom_multi = GhPythonScript(
    top_dir=path,
    key="100_035_035_050_010_090_008_to_050_025_025_025_050_005_025",
    index=Slider(3, range=0..3),
    step=Slider(21, range=0..21))  # -> graft(pc), p; inputs index: Int32
# ---------- interpolate_custom_multi: Python ----------
__author__ = "Ozguc"
__version__ = "2021.04.27"

import rhinoscriptsyntax as rs
import os

def importPLY(fn):
    with open(fn) as f:
        contents = f.readlines()
        
    pc = []
    while len(contents) > 0:
        line = contents.pop(0).split()
        try:
            x = float(line[0])
            y = float(line[1])
            z = float(line[2])
            pc.append(rs.AddPoint(x,y,z))
        except:
            pass
    return pc

def decodeFiles(dir, key):
    files = os.listdir(dir)
    
    all_i = []
    all_fn = []
    
    for i in range(len(files)):
        if key in files[i]:
            all_fn.append(files[i])
        
        cur_i = files[i].split("_")[2]
        if cur_i not in all_i:
            all_i.append(cur_i)
    
    return all_i, all_fn

def interpolateParams(fn, step):
    params = fn.split("_")
    s = params[:7]
    t = params[8:]
    p = []
    tmp = step/21
    for i in range(len(s)):
        p.append((int(s[i])+(int(t[i])-int(s[i]))*tmp)/100)
    return p

def main():
    all_i, all_fn = decodeFiles(top_dir, key)
    
    p = interpolateParams(key, step)
    
    fn = top_dir+key+"_%02d.ply" % step
    print(fn)
    pc = importPLY(fn)
    return pc, p

pc, p = main()
# ---------- end interpolate_custom_multi ----------
interpolate_custom_multi_2 = GhPythonScript(top_dir=path_2, key=panel, index=number_slider, step=number_slider_2)  # -> graft(pc), i; inputs index: Int32; disabled
# ---------- interpolate_custom_multi_2: Python ----------
__author__ = "Ozguc"
__version__ = "2021.04.27"

import rhinoscriptsyntax as rs
import os

def importPLY(fn):
    with open(fn) as f:
        contents = f.readlines()
        
    pc = []
    while len(contents) > 0:
        line = contents.pop(0).split()
        try:
            x = float(line[0])
            y = float(line[1])
            z = float(line[2])
            pc.append(rs.AddPoint(x,y,z))
        except:
            pass
    return pc

def decodeFiles(dir, key):
    files = os.listdir(dir)
    
    all_i = []
    all_fn = []
    
    for i in range(len(files)):
        if key in files[i]:
            all_fn.append(files[i])
        
        cur_i = files[i].split("_")[2]
        if cur_i not in all_i:
            all_i.append(cur_i)
    
    return all_i, all_fn

def main():
    all_i, all_fn = decodeFiles(top_dir, key)
    
    fn = top_dir+"simple_%s_%04d_%02d"%(key, int(all_i[index]), step)
    pc = importPLY(fn)
    return pc, all_i[index]

pc, i = main()
# ---------- end interpolate_custom_multi_2 ----------

pdecon = Deconstruct(Point=interpolate_custom_multi_2.pc)  # -> XComponent, YComponent, ZComponent; disabled
camera = GhPythonScript()  # -> c, t; disabled
# ---------- camera: Python ----------
__author__ = "Ozguc"
__version__ = "2021.04.26"

import rhinoscriptsyntax as rs
import Rhino

c = Rhino.RhinoDoc.ActiveDoc.Views.ActiveView.ActiveViewport.CameraLocation
t = Rhino.RhinoDoc.ActiveDoc.Views.ActiveView.ActiveViewport.CameraTarget
# ---------- end camera ----------
pdecon_2 = Deconstruct(Point=camera.c)  # -> XComponent, YComponent, ZComponent; disabled
pt = ConstructPoint(XCoordinate=pdecon_2.XComponent, YCoordinate=pdecon_2.YComponent, ZCoordinate=0)  # disabled
pt_2 = ConstructPoint(XCoordinate=pdecon.XComponent, YCoordinate=pdecon.YComponent, ZCoordinate=0)  # disabled
vec2pt = Vector2Pt(PointA=camera.c, PointB=camera.t, Unitize=False)  # -> Vector, Length; disabled
dist = Distance(PointA=pt_2, PointB=pt)  # disabled
pl = PlaneNormal(Origin=camera.c, ZAxis=vec2pt.Vector)  # disabled
panel_2 = Panel("0.005 To 0.0035")  # disabled
cp = PlaneClosestPoint(Point=interpolate_custom_multi_2.pc, Plane=pl)  # -> Point, UVPoint, Distance; disabled
bnd = Bounds(Numbers=dist)  # disabled
panel_3 = Panel("0.0025 To 0.005")  # disabled
bnd_2 = Bounds(Numbers=dist)  # disabled
remap = RemapNumbers(Value=dist, Source=bnd, Target=panel_2)  # -> Mapped, Clipped; disabled
remap_2 = RemapNumbers(Value=dist, Source=bnd_2, Target=panel_3)  # -> Mapped, Clipped; disabled
dots = DotDisplay(Point=interpolate_custom_multi_2.pc, Colour=RGB(0, 0, 0), Size=remap_2.Mapped)  # disabled

simple_random_samples = GhPythonScript(s=interpolate_custom_multi_2.i)  # -> srf; inputs s: Int32; disabled
# ---------- simple_random_samples: Python ----------
"""
Generates step^7 number of samples covering the entirety of the parametric design space
    Inputs:
        n: Number of data points to export
        run: Toggle "True" to export .ply files
    Remarks:
        Author: Ozguc Bertug Capunaman
        Project: Latent Heuristics
        Version: 2021.04.20
"""

import rhinoscriptsyntax as rs
import ghpythonlib.components as gh
import random, os, math

def writePC(fn, pc, dir):

    f = open(dir+fn+".ply", "w")
    f.write('ply\n')
    f.write('format ascii 1.0\n')
    f.write('element vertex {}\n'.format(len(pc)))
    f.write('property float x\n')
    f.write('property float y\n')
    f.write('property float z\n')
    f.write('end_header\n')
    
    for p in pc:
        f.write("{} {} {}\n".format(p[0],p[1],p[2]))
    f.close()
    print("Finished exporting {}.ply".format(fn))

def createFN(vars):
    fn = ""
    for i in range(len(vars)):
        if i != 0:
            fn+= "_"
        fn += str(vars[i])
    return fn



def randomSpline(s):
    
    h = random.uniform(.5, 1)
    bR = random.uniform(h*.2, h*.5)
    tR = random.uniform(bR*.25, bR)
    
    bZ = random.uniform(h*.1,h*.9)
    tZ = random.uniform(h*.1,h*.9)
    
    bX = random.uniform(bR, bR*2)
    tX = random.uniform(tR*.5, tR*2)
    
    pts = []
    pts.append(gh.ConstructPoint(bR, 0, 0))
    pts.append(gh.ConstructPoint(bX, 0, bZ))
    pts.append(gh.ConstructPoint(tX, 0, tZ))
    pts.append(gh.ConstructPoint(tR, 0, h))
    
    crv = gh.NurbsCurve(pts, 3, False)
    return crv

def main(s, dir):
    if not os.path.exists(dir):
            os.mkdir(dir)
    
    start = gh.ConstructPoint(0, 0, 0)
    end = gh.ConstructPoint(0, 0, 1)
    axis = gh.Line(start,end)
    
    random.seed(s)
    crv = randomSpline(s).curve
    srf = gh.Revolution(crv, axis, "0 To 2*Pi")

    return srf

srf = main(s, dir="C:\\Users\\Ozguc\\Documents\\GitHub\\latentHeuristics\\ghData\\data\\00000001\\")
# ---------- end simple_random_samples ----------
spiral_random_samples = GhPythonScript(s=interpolate_custom_multi_2.i)  # -> srf; inputs s: Int32; disabled
# ---------- spiral_random_samples: Python ----------
"""
Generates step^7 number of samples covering the entirety of the parametric design space
    Inputs:
        n: Number of data points to export
        run: Toggle "True" to export .ply files
    Remarks:
        Author: Ozguc Bertug Capunaman
        Project: Latent Heuristics
        Version: 2021.04.20
"""

import rhinoscriptsyntax as rs
import ghpythonlib.components as gh
import random, os, math

def writePC(fn, pc, dir):

    f = open(dir+fn+".ply", "w")
    f.write('ply\n')
    f.write('format ascii 1.0\n')
    f.write('element vertex {}\n'.format(len(pc)))
    f.write('property float x\n')
    f.write('property float y\n')
    f.write('property float z\n')
    f.write('end_header\n')
    
    for p in pc:
        f.write("{} {} {}\n".format(p[0],p[1],p[2]))
    f.close()
    print("Finished exporting {}.ply".format(fn))

def createFN(vars):
    fn = ""
    for i in range(len(vars)):
        if i != 0:
            fn+= "_"
        fn += str(vars[i])
    return fn



def randomSpline(s):
    
    h = random.uniform(.5, 1)
    bR = random.uniform(h*.2, h*.5)
    tR = random.uniform(bR*.25, bR)
    
    bZ = random.uniform(h*.1,h*.9)
    tZ = random.uniform(h*.1,h*.9)
    
    bX = random.uniform(bR, bR*2)
    tX = random.uniform(tR*.5, tR*2)
    
    pts = []
    pts.append(gh.ConstructPoint(bR, 0, 0))
    pts.append(gh.ConstructPoint(bX, 0, bZ))
    pts.append(gh.ConstructPoint(tX, 0, tZ))
    pts.append(gh.ConstructPoint(tR, 0, h))
    
    crv = gh.NurbsCurve(pts, 3, False)
    return crv.curve, h

def main(dir):
    if not os.path.exists(dir):
            os.mkdir(dir)
    
    start = gh.ConstructPoint(0, 0, 0)
    end = gh.ConstructPoint(0, 0, 1)
    axis = gh.Line(start,end)
    
    random.seed(s)
    
    crv, h = randomSpline(s)
    
    div = 12
    pts = gh.DivideCurve(crv, div, False)[0]
    
    tA = 0#random.uniform(-math.pi/2, math.pi/2) 
    bA = 0#random.uniform(-math.pi/2, math.pi/2)
    peak = random.randint(0+1, len(pts)-1)
    bStep = bA/(peak+1)
    tStep = tA/(len(pts)-peak)
    
    for i in range(len(pts)):
        if i < peak:
            pts[i] = gh.Rotate(pts[i], bStep*(peak-i), gh.XYPlane("0,0,0"))[0]
        if i > peak:
            pts[i] = gh.Rotate(pts[i], tStep*(i-peak), gh.XYPlane("0,0,0"))[0]
    crv0 = gh.NurbsCurve(pts, 3, False).curve
   
    mult=random.uniform(.1,.25)
    
    for i in range(len(pts)):
       dist = gh.Distance(pts[i], "0,0,{}".format(pts[i][2]))
       
       vec = gh.Vector2Pt("{},{},{}".format(pts[i][0]*mult, pts[i][1]*mult,0), "0,0,0", False)[0]
       pts[i] = gh.Move(pts[i], vec)[0]
    crv1 = gh.NurbsCurve(pts, 3, False).curve
    
    crv = []
    nSpiral = random.randint(3, 18)
    for i in range(nSpiral):
        crv.append(gh.Rotate(crv0, (i*2*math.pi)/nSpiral, gh.XYPlane("0,0,0"))[0])
        crv.append(gh.Rotate(crv1, ((i*2*math.pi)/nSpiral)+(math.pi)/nSpiral, gh.XYPlane("0,0,0"))[0])
    
    srf = rs.AddLoftSrf(crv, closed=True)
    return srf

srf = main(dir="C:\\Users\\Ozguc\\Documents\\GitHub\\latentHeuristics\\ghData\\data\\00000001\\")
# ---------- end spiral_random_samples ----------
lowpoly_random_samples = GhPythonScript(s=interpolate_custom_multi_2.i)  # -> mesh; inputs s: Int32; disabled
# ---------- lowpoly_random_samples: Python ----------
"""
Generates step^7 number of samples covering the entirety of the parametric design space
    Inputs:
        n: Number of data points to export
        run: Toggle "True" to export .ply files
    Remarks:
        Author: Ozguc Bertug Capunaman
        Project: Latent Heuristics
        Version: 2021.04.20
"""

import rhinoscriptsyntax as rs
import ghpythonlib.components as gh
import random, os, math
from itertools import permutations

def writePC(fn, pc, dir):

    f = open(dir+fn+".ply", "w")
    f.write('ply\n')
    f.write('format ascii 1.0\n')
    f.write('element vertex {}\n'.format(len(pc)))
    f.write('property float x\n')
    f.write('property float y\n')
    f.write('property float z\n')
    f.write('end_header\n')
    
    for p in pc:
        f.write("{} {} {}\n".format(p[0],p[1],p[2]))
    f.close()
    print("Finished exporting {}.ply".format(fn))

def createFN(vars):
    fn = ""
    for i in range(len(vars)):
        if i != 0:
            fn+= "_"
        fn += str(vars[i])
    return fn

def randomSpline(s):
    
    h = random.uniform(.5, 1)
    bR = random.uniform(h*.2, h*.5)
    tR = random.uniform(bR*.25, bR)
    
    bZ = random.uniform(h*.1,h*.9)
    tZ = random.uniform(h*.1,h*.9)
    
    bX = random.uniform(bR, bR*2)
    tX = random.uniform(tR*.5, tR*2)
    
    pts = []
    pts.append(gh.ConstructPoint(bR, 0, 0))
    pts.append(gh.ConstructPoint(bX, 0, bZ))
    pts.append(gh.ConstructPoint(tX, 0, tZ))
    pts.append(gh.ConstructPoint(tR, 0, h))
    
    crv = gh.NurbsCurve(pts, 3, False)
    return crv

def lowPoly(srf):
    mesh = gh.DeconstructMesh(srf)
    
    nSample = random.randint(15, 60)
    print(nSample)
    pc = gh.PopulateGeometry(srf, nSample, 1)
    edges = gh.BrepEdges(srf).naked
    for e in edges:
        nDiv = gh.Length(e)//.1
        if nDiv < 5:
            nDiv = 5
        pc.extend(gh.DivideCurve(e, nDiv, False).points)
    
    meshPts = []
    vertDict = {}
    for i in range(len(mesh.vertices)):
        cpi = gh.ClosestPoint(mesh.vertices[i], pc).cp_index
        meshPts.append(pc[cpi])
        vertDict[i] = cpi
    srf0 = gh.ConstructMesh(meshPts, mesh.faces)
    mesh = gh.DeconstructMesh(srf0)
    faceSet = []
    for f in mesh.faces:
        face = []
        verts = gh.DeconstructFace(f)
        face.append([vertDict[verts.corner_a],\
                vertDict[verts.corner_b],\
                vertDict[verts.corner_c]])
        if verts.corner_c != verts.corner_d:
            face.append([vertDict[verts.corner_a],\
                   vertDict[verts.corner_c],\
                   vertDict[verts.corner_d]])
        isIn = False
        for f in face:
            if f[0]!=f[1] and f[1]!=f[2] and f[0]!=f[2]:
                for p in permutations(f):
                    if tuple(p) in faceSet:
                        isIn = True
                        break
                if not isIn:
                    faceSet.append(tuple(f))
    faces=[]
    for f in faceSet:
        faces.append(gh.MeshTriangle(f[0], f[1], f[2]))
    srf = gh.ConstructMesh(pc, faces)
    return srf

def main(dir):
    if not os.path.exists(dir):
            os.mkdir(dir)
    
    start = gh.ConstructPoint(0, 0, 0)
    end = gh.ConstructPoint(0, 0, 1)
    axis = gh.Line(start,end)
    
    random.seed(s)
    crv = randomSpline(s).curve
    srf = gh.Revolution(crv, axis, "0 To 2*Pi")
    srf = lowPoly(srf)

    return srf

mesh = main(dir="C:\\Users\\Ozguc\\Documents\\GitHub\\latentHeuristics\\ghData\\data\\00000001\\")
# ---------- end lowpoly_random_samples ----------
asymmetric_random_samples = GhPythonScript(s=interpolate_custom_multi_2.i)  # -> srf; inputs s: Int32; disabled
# ---------- asymmetric_random_samples: Python ----------
"""
Generates step^7 number of samples covering the entirety of the parametric design space
    Inputs:
        n: Number of data points to export
        run: Toggle "True" to export .ply files
    Remarks:
        Author: Ozguc Bertug Capunaman
        Project: Latent Heuristics
        Version: 2021.04.20
"""

import rhinoscriptsyntax as rs
import ghpythonlib.components as gh
import random, os, math

def writePC(fn, pc, dir):

    f = open(dir+fn+".ply", "w")
    f.write('ply\n')
    f.write('format ascii 1.0\n')
    f.write('element vertex {}\n'.format(len(pc)))
    f.write('property float x\n')
    f.write('property float y\n')
    f.write('property float z\n')
    f.write('end_header\n')
    
    for p in pc:
        f.write("{} {} {}\n".format(p[0],p[1],p[2]))
    f.close()
    print("Finished exporting {}.ply".format(fn))

def createFN(vars):
    fn = ""
    for i in range(len(vars)):
        if i != 0:
            fn+= "_"
        fn += str(vars[i])
    return fn



def randomSpline(s):
    
    h = random.uniform(.5, 1)
    bR = random.uniform(h*.2, h*.5)
    tR = random.uniform(bR*.25, bR)
    
    bZ = random.uniform(h*.1,h*.9)
    tZ = random.uniform(h*.1,h*.9)
    
    bX = random.uniform(bR, bR*2)
    tX = random.uniform(tR*.5, tR*2)
    
    pts = []
    pts.append(gh.ConstructPoint(bR, 0, 0))
    pts.append(gh.ConstructPoint(bX, 0, bZ))
    pts.append(gh.ConstructPoint(tX, 0, tZ))
    pts.append(gh.ConstructPoint(tR, 0, h))
    
    crv = gh.NurbsCurve(pts, 3, False)
    return crv

def crvFromCir(pt, r, reverse, deform):
    div = random.randint(3, 10)
    crv = rs.AddCircle(pt, r)
    
    cirPts = rs.DivideCurve(crv, div)
    
    if deform:
        ptR = random.uniform(r*.4, r*.8)
        ptA = random.uniform(0, 360)
        
        attr = rs.AddPoint(pt)
        rs.MoveObject(attr, (ptR,0,0))
        rs.RotateObject(attr, pt, ptA)
        
        for cirPt in cirPts:
            dist = rs.Distance(attr, cirPt)
            if dist < r and random.getrandbits(1):
                vec = rs.VectorCreate(cirPt, attr)
                vec = rs.VectorScale(vec, (r-dist)/(dist))
                
                if random.getrandbits(1) and reverse:
                    vec = rs.VectorReverse(vec)
                rs.MoveObject(cirPt, vec)
                
    cirPts.append(cirPts[0])
    crv = rs.AddInterpCurve(cirPts, knotstyle=4)
        
#    vec = rs.VectorCreate(pt, rs.CurveAreaCentroid(crv)[0])
#    crv = rs.MoveObject(crv, vec)
        
    return crv

def main(dir):
    if not os.path.exists(dir):
            os.mkdir(dir)
    
    start = gh.ConstructPoint(0, 0, 0)
    end = gh.ConstructPoint(0, 0, 1)
    axis = gh.Line(start,end)
    
    random.seed(s)
    crv = randomSpline(s).curve
    pts = gh.ControlPoints(crv).points
#        pts = sorted(pts,key=lambda x:x[2])
    
    crv = []
    for i in range(len(pts)):
        reverse = True
        deform = True
        if i == 0:
            deform = False
        elif i == len(pts)-1:
            reverse = False
    
        c = crvFromCir("0,0,{}".format(pts[i][2]), pts[i][0], reverse, deform)
        crv.append(c)
    
    srf = rs.AddLoftSrf(crv, loft_type=1)
    return srf


srf = main(dir="C:\\Users\\Ozguc\\Documents\\GitHub\\latentHeuristics\\ghData\\data\\00000001\\")
# ---------- end asymmetric_random_samples ----------
number_slider_3 = Slider(10, range=0..100)
eval = EvaluateCurve(Curve=reparameterize(ln), Parameter=expr("x/21", Slider(21, range=0..21)))  # -> Point, Tangent, Angle
number_slider_4 = Slider(10, range=0..100)  # disabled
simple_design_space = GhPythonScript(p=interpolate_custom_multi.p)  # -> srf; inputs p: list
# ---------- simple_design_space: Python ----------
"""
Generates step^7 number of samples covering the entirety of the parametric design space
    Inputs:
        step: Number of samples to take from each domain
        run: Toggle "True" to export .ply files
    Remarks:
        Author: Ozguc Bertug Capunaman
        Project: Latent Heuristics
        Version: 2021.04.20
"""

__author__ = "Ozguc Bertug Capunaman"
__version__ = "2021.04.14"

import rhinoscriptsyntax as rs
import ghpythonlib.components as gh
import os

def writePC(fn, pc, dir):

    f = open(dir+fn+".ply", "w")
    f.write('ply\n')
    f.write('format ascii 1.0\n')
    f.write('element vertex {}\n'.format(len(pc)))
    f.write('property float x\n')
    f.write('property float y\n')
    f.write('property float z\n')
    f.write('end_header\n')
    
    for p in pc:
        f.write("{} {} {}\n".format(p[0],p[1],p[2]))
    f.close()
    print("Finished exporting {}.ply".format(fn))

def createFN(vars):
    fn = ""
    for i in range(len(vars)):
        if i != 0:
            fn+= "_"
        fn += str(int((vars[i]*100)))
    return fn

def main(dir):
    start = gh.ConstructPoint(0, 0, 0)
    end = gh.ConstructPoint(0, 0, 1)
    axis = gh.Line(start,end)
    
    h = p[0]
    bR = p[1]
    bX = p[2]
    bZ = p[3]
    tX = p[4]
    tZ = p[5]
    tR = p[6]
    
    pts = []
    pts.append(gh.ConstructPoint(bR, 0, 0))
    pts.append(gh.ConstructPoint(bX, 0, bZ))
    pts.append(gh.ConstructPoint(tX, 0, tZ))
    pts.append(gh.ConstructPoint(tR, 0, h))

    crv = gh.NurbsCurve(pts, 3, False)[0]
    srf = gh.Revolution(crv, axis, "0 To 2*Pi")
    return srf

srf = main(dir="C:\\Users\\Ozguc\\Documents\\GitHub\\latentHeuristics\\ghData\\data\\00000000\\")
# ---------- end simple_design_space ----------
Z = UnitZ(Factor=".1")
panel_4 = Panel("#90be6d")  # disabled
cir = Circle(Plane=eval.Point, Radius=Slider(0.01, range=0..0.1))
material = CreateMaterial(
    Diffuse="#90be6d",
    Specular="#90be6d",
    Emission=RGB(0, 0, 0),
    Transparency=Slider(0.75, range=0..1),
    Shine=number_slider_3)
srf_cp = SurfaceClosestPoint(Point=graft(interpolate_custom_multi.pc), Surface=simple_design_space)  # -> Point, UVPoint, Distance
boundary = BoundarySurfaces(Edges=cir)
material_2 = CreateMaterial(Diffuse=panel_4, Specular=panel_4, Emission=RGB(0, 0, 0), Transparency=0, Shine=number_slider_4)  # disabled

# ---- group: Point Cloud Visualization
camera_2 = GhPythonScript()  # -> c, t; disabled; same code as camera
vec2pt_2 = Vector2Pt(PointA=interpolate_custom_multi_2.pc, PointB=camera_2.c, Unitize=False)  # -> Vector, Length; disabled
pl_2 = PlaneNormal(Origin=interpolate_custom_multi_2.pc, ZAxis=vec2pt_2.Vector)  # disabled
panel_5 = Panel("0.005")  # disabled
panel_6 = Panel("0.0055")  # disabled
cir_2 = Circle(Plane=pl_2, Radius=panel_5)  # disabled
cir_3 = Circle(Plane=pl_2, Radius=panel_6)  # disabled
boundary_2 = BoundarySurfaces(Edges=cir_2)  # disabled

# ----
material_3 = CreateMaterial(Diffuse="#90be6d", Specular="#90be6d", Emission=RGB(0, 0, 0), Transparency=0, Shine=number_slider_3)
move = Move(Geometry=boundary, Motion=Z)  # -> Geometry, Transform

# ---- group: Point Cloud Visualization
camera_3 = GhPythonScript()  # -> c, t; same code as camera
vec2pt_3 = Vector2Pt(PointA=interpolate_custom_multi.pc, PointB=camera_3.c, Unitize=False)  # -> Vector, Length
pl_3 = PlaneNormal(Origin=interpolate_custom_multi.pc, ZAxis=vec2pt_3.Vector)
cir_4 = Circle(Plane=pl_3, Radius="0.005")
cir_5 = Circle(Plane=pl_3, Radius="0.0055")
boundary_3 = BoundarySurfaces(Edges=cir_4)

# ----
preview = CustomPreview(Geometry=simple_design_space, Material=material)
preview_2 = CustomPreview(Geometry=asymmetric_random_samples, Material=material_2)  # disabled

panel_7 = Panel("0.0045")  # disabled
panel_8 = Panel("0.0035")  # disabled

preview_3 = CustomPreview(Geometry=move.Geometry, Material=material_3)
preview_4 = CustomPreview(Geometry=ln, Material=ColourSwatch(SwatchColor=RGB(0, 0, 0)))

panel_9 = Panel("0.0045")
panel_10 = Panel("0.0035")

panel_11 = Panel(".02")  # disabled
panel_12 = Panel("0")  # disabled

srf_cp_2 = SurfaceClosestPoint(Point=graft(interpolate_custom_multi_2.pc), Surface=simple_random_samples)  # -> Point, UVPoint, Distance; disabled
gradient = Gradient(
    LowerLimit=panel_11,
    UpperLimit=panel_12,
    Parameter=srf_cp_2.Distance,
    stops=[0: RGB(234, 38, 0), 0.25: RGB(234, 126, 0), 0.5: RGB(254, 244, 84), 0.75: RGB(173, 203, 249), 1: RGB(75, 107, 169)])  # disabled

meshcp = MeshClosestPoint(Point=interpolate_custom_multi_2.pc, Mesh=lowpoly_random_samples)  # -> Point, Index, Parameter; disabled
dist_2 = Distance(PointA=interpolate_custom_multi_2.pc, PointB=meshcp.Point)  # disabled
gradient_2 = Gradient(
    LowerLimit=panel_11,
    UpperLimit=panel_12,
    Parameter=dist_2,
    stops=[0: RGB(234, 38, 0), 0.25: RGB(234, 126, 0), 0.5: RGB(254, 244, 84), 0.75: RGB(173, 203, 249), 1: RGB(75, 107, 169)])  # disabled

gradient_3 = Gradient(
    LowerLimit=".04",
    UpperLimit="0",
    Parameter=srf_cp.Distance,
    stops=[0: RGB(234, 38, 0), 0.25: RGB(234, 126, 0), 0.5: RGB(254, 244, 84), 0.75: RGB(173, 203, 249), 1: RGB(75, 107, 169)])
bnd_3 = Bounds(Numbers=flatten(srf_cp.Distance))

number_slider_5 = Slider(10, range=0..100)  # disabled
number_slider_6 = Slider(10, range=0..100)  # disabled
panel_13 = Panel("#90be6d")  # disabled
panel_14 = Panel("#00ff00")  # disabled
swatch = ColourSwatch(SwatchColor=RGB(50, 100, 0))  # disabled
material_4 = CreateMaterial(Diffuse=panel_13, Specular=panel_13, Emission=RGB(0, 0, 0), Transparency=0, Shine=number_slider_5)  # disabled
material_5 = CreateMaterial(Diffuse=panel_14, Specular=panel_14, Emission=RGB(0, 0, 0), Transparency=0, Shine=number_slider_6)  # disabled
preview_5 = CustomPreview(Geometry=boundary_3, Material=material_4)  # disabled
preview_6 = CustomPreview(Geometry=cir_5, Material=swatch)  # disabled

number_slider_7 = Slider(10, range=0..100)  # disabled
number_slider_8 = Slider(10, range=0..100)  # disabled
panel_15 = Panel("#90be6d")  # disabled
panel_16 = Panel("#00ff00")  # disabled
swatch_2 = ColourSwatch(SwatchColor=RGB(50, 100, 0))  # disabled
material_6 = CreateMaterial(Diffuse=panel_15, Specular=panel_15, Emission=RGB(0, 0, 0), Transparency=0, Shine=number_slider_7)  # disabled
material_7 = CreateMaterial(Diffuse=panel_16, Specular=panel_16, Emission=RGB(0, 0, 0), Transparency=0, Shine=number_slider_8)  # disabled
preview_7 = CustomPreview(Geometry=boundary_2, Material=material_6)  # disabled
preview_8 = CustomPreview(Geometry=cir_3, Material=swatch_2)  # disabled

bbox = BoundingBox(Content=interpolate_custom_multi_2.pc, Plane=PlaneXY(0, 0, 0), UnionBox=True)  # -> Box, Box_2; disabled
debox = DeconstructBox(Box=bbox.Box)  # -> Plane, X, Y, Z; disabled
dedomain = DeconstructDomain(Domain=debox.X)  # -> Start, End; disabled
dedomain_2 = DeconstructDomain(Domain=debox.Z)  # -> Start, End; disabled
dedomain_3 = DeconstructDomain(Domain=debox.Y)  # -> Start, End; disabled
pt_3 = ConstructPoint(XCoordinate=0, YCoordinate=0, ZCoordinate=dedomain_2.Start)  # disabled
max = Maximum(A=dedomain_3.Start, B=dedomain_3.End)  # disabled
max_2 = Maximum(A=dedomain.Start, B=dedomain.End)  # disabled
subtraction = Subtraction(A=dedomain_2.End, B=dedomain_2.Start)  # disabled
max_3 = Maximum(A=max_2, B=max)  # disabled
cyl = Cylinder(Base=pt_3, Radius=max_3, Length=subtraction)  # disabled
srf_cp_3 = SurfaceClosestPoint(Point=interpolate_custom_multi_2.pc, Surface=cyl)  # -> Point, UVPoint, Distance; disabled
pt_4 = Point(srf_cp_3.UVPoint)  # disabled
del = DelaunayMesh(Points=pt_4, Plane=PlaneXY(0, 0, 0))  # disabled
demesh = DeconstructMesh(Mesh=del)  # -> Vertices, Faces, Colours, Normals; disabled
conmesh = ConstructMesh(Vertices=interpolate_custom_multi_2.pc, Faces=demesh.Faces)  # disabled

number_slider_9 = Slider(10, range=0..100)  # disabled
number_slider_10 = Slider(10, range=0..100)  # disabled
panel_17 = Panel("#90be6d")
panel_18 = Panel("#00ff00")
panel_19 = Panel("#90be6d")  # disabled
panel_20 = Panel("#00ff00")  # disabled
swatch_3 = ColourSwatch(SwatchColor=RGB(0, 0, 0))  # disabled
material_8 = CreateMaterial(Diffuse=gradient_3, Specular=gradient_3, Emission=RGB(0, 0, 0), Transparency=0, Shine=Slider(10, range=0..100))
material_9 = CreateMaterial(Diffuse=gradient_3, Specular=gradient_3, Emission=RGB(0, 0, 0), Transparency=0, Shine=Slider(10, range=0..100))
material_10 = CreateMaterial(Diffuse=gradient, Specular=gradient, Emission=RGB(0, 0, 0), Transparency=0, Shine=number_slider_9)  # disabled
material_11 = CreateMaterial(Diffuse=gradient, Specular=gradient, Emission=RGB(0, 0, 0), Transparency=0, Shine=number_slider_10)  # disabled
preview_9 = CustomPreview(Geometry=boundary_3, Material=material_8)
preview_10 = CustomPreview(Geometry=cir_5, Material=ColourSwatch(SwatchColor=RGB(0, 0, 0)))
preview_11 = CustomPreview(Geometry=boundary_2, Material=material_10)  # disabled
preview_12 = CustomPreview(Geometry=cir_3, Material=swatch_3)  # disabled
material_12 = CreateMaterial(Diffuse="#90be6d", Specular="#90be6d", Emission=RGB(0, 0, 0), Transparency=0, Shine=Slider(10, range=0..100))
preview_13 = CustomPreview(Geometry=conmesh, Material=material_12)
